# Grasshopper definition example.gh (Grasshopper 0.9.76)
# plug-ins: gHowl, LunchBox

number_slider = Slider(7, range=0..100)
# be sure to use 'Triangular Panels A'
srf = Surface(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)
tria = TriangularPanelsA(Surface=srf, UDivisions=number_slider, VDivisions=number_slider)
debrep = DeconstructBrep(Brep=tria)  # -> Faces, Edges, flatten(Vertices)
pdecon = Deconstruct(Point=debrep.Vertices)  # -> XComponent, YComponent, ZComponent
int = Integer(pdecon.XComponent)
concat = Concatenate(FragmentA=int, FragmentB=",")
int_2 = Integer(pdecon.YComponent)
concat_2 = Concatenate(FragmentA=concat, FragmentB=int_2)
concat_3 = Concatenate(FragmentA=concat_2, FragmentB=",")
int_3 = Integer(pdecon.ZComponent)
concat_4 = Concatenate(FragmentA=concat_3, FragmentB=int_3)
concat_5 = Concatenate(FragmentA=concat_4, FragmentB=",")
join = TextJoin(Text=concat_5)
len = TextLength(Text=join)
subtraction = Subtraction(A=len, B=Slider(1, range=0..10))
fragment = TextFragment(Text=join, Start=Slider(0, range=0..1), Count=subtraction)
port_to_send_to = Panel("8051")
sending_pattern = Panel("0")
panel = Panel("gHowl UDP sender")
udp_owl = UDPSender(Port=port_to_send_to, Pattern=sending_pattern, Data=fragment)
panel_2 = Panel(fragment)
