# Grasshopper definition example1(cubes).gh (Grasshopper 0.9.76)
# plug-ins: gHowl, LunchBox

number_slider = Slider(29, range=0..100)

number_slider_2 = Slider(2, range=0..10)
subtraction = Subtraction(A=number_slider_2, B=1)
pt = ConstructPoint(
    XCoordinate=Slider(-53, range=-100..100),
    YCoordinate=Slider(-32, range=-100..100),
    ZCoordinate=Slider(64, range=-100..100))
series = Series(Start=0, Step=number_slider, Count=number_slider_2)
multiplication = Multiplication(A=number_slider, B=subtraction)
multiplication_2 = Multiplication(A=multiplication, B=Slider(-1, range=-1..1))
division = Division(A=multiplication_2, B=Slider(2, range=0..10))
X = UnitX(Factor=series)
Z = UnitZ(Factor=division)
Y = UnitY(Factor=division)
X_2 = UnitX(Factor=division)
Y_2 = UnitY(Factor=series)
move = Move(Geometry=pt, Motion=X)  # -> Geometry, Transform
graft = GraftTree(Tree=move.Geometry, IncludeEmptyLists=True, IncludeNullItems=True)
move_2 = Move(Geometry=graft, Motion=Y_2)  # -> Geometry, Transform
Z_2 = UnitZ(Factor=series)
graft_2 = GraftTree(Tree=move_2.Geometry, IncludeEmptyLists=True, IncludeNullItems=True)
move_3 = Move(Geometry=graft_2, Motion=Z_2)  # -> Geometry, Transform
platocube = PlatonicCube(Plane=move_3.Geometry, Radius=Slider(7.5, range=0..10), Truncation=0)
debrep = DeconstructBrep(Brep=platocube)  # -> Faces, Edges, Vertices
move_4 = Move(Geometry=debrep.Faces, Motion=X_2)  # -> Geometry, Transform
move_5 = Move(Geometry=move_4.Geometry, Motion=Y)  # -> Geometry, Transform
move_6 = Move(Geometry=move_5.Geometry, Motion=Z)  # -> Geometry, Transform

number_slider_3 = Slider(20, range=0..100)  # disabled
number_slider_4 = Slider(20, range=0..100)  # disabled
rectangle = Rectangle(Plane=PlaneXY(0, 0, 0), XSize=number_slider_4, YSize=number_slider_3, Radius=0)  # -> Rectangle, Length; disabled
number_slider_5 = Slider(-29, range=-100..100)  # disabled
number_slider_6 = Slider(34, range=-100..100)  # disabled
X_3 = UnitX(Factor=number_slider_5)  # disabled
number_slider_7 = Slider(9, range=0..10)  # disabled
move_7 = Move(Geometry=rectangle.Rectangle, Motion=X_3)  # -> Geometry, Transform; disabled
Y_3 = UnitY(Factor=number_slider_6)  # disabled
move_8 = Move(Geometry=move_7.Geometry, Motion=Y_3)  # -> Geometry, Transform; disabled
Z_3 = UnitZ(Factor=number_slider_7)  # disabled
extr = Extrude(Base=move_8.Geometry, Direction=Z_3)  # disabled
cap = CapHoles(Brep=extr)  # disabled
debrep_2 = DeconstructBrep(Brep=cap)  # -> Faces, Edges, Vertices; disabled

number_slider_8 = Slider(8, range=0..100)
# Get the faces of a rectangular box
pt_2 = ConstructPoint(XCoordinate=Slider(-17, range=-100..100), YCoordinate=Slider(46, range=-100..100), ZCoordinate=number_slider_8)
box = CenterBox(Base=pt_2, X=Slider(-32, range=-100..100), Y=Slider(5, range=-100..100), Z=number_slider_8)
debrep_3 = DeconstructBrep(Brep=box)  # -> Faces, Edges, Vertices
number_slider_9 = Slider(1, range=0..100)
# Translate the surfaces into meshes
# (be sure to use 'Triangular Panels A')
tria = TriangularPanelsA(Surface=move_6.Geometry, UDivisions=number_slider_9, VDivisions=number_slider_9)
debrep_4 = DeconstructBrep(Brep=tria)  # -> Faces, Edges, flatten(Vertices)
pdecon = Deconstruct(Point=debrep_4.Vertices)  # -> XComponent, YComponent, ZComponent
int = Integer(pdecon.XComponent)
concat = Concatenate(FragmentA=int, FragmentB=",")
int_2 = Integer(pdecon.YComponent)
concat_2 = Concatenate(FragmentA=concat, FragmentB=int_2)
concat_3 = Concatenate(FragmentA=concat_2, FragmentB=",")
int_3 = Integer(pdecon.ZComponent)
concat_4 = Concatenate(FragmentA=concat_3, FragmentB=int_3)
concat_5 = Concatenate(FragmentA=concat_4, FragmentB=",")
join = TextJoin(Text=concat_5)
len = TextLength(Text=join)
subtraction_2 = Subtraction(A=len, B=Slider(1, range=0..10))
fragment = TextFragment(Text=join, Start=Slider(0, range=0..1), Count=subtraction_2)
port_to_send_to = Panel("8051")
sending_pattern = Panel("0")
panel = Panel("gHowl UDP sender")
parsed_mesh_data = Panel(fragment)
udp_owl = UDPSender(Port=port_to_send_to, Pattern=sending_pattern, Data=fragment)
